# Grasshopper definition example.gh (Grasshopper 1.0.8)
# plug-ins: Pawper

_01_new = NewDocument()
_03_heading = Heading(Text="Primo documento", Level=0)
_04_paragraph = Paragraph(Text="Questo documento è stato generato con Pawper. Il testo rimane modificabile in Microsoft Word.", StyleID="Normal")
_02_compose = ComposeDocument(Document=_01_new, Blocks=flatten([_03_heading, _04_paragraph]))
_05_inspect = DocumentInspector(Document=_02_compose)  # -> Structure, Styles, Bookmarks, Controls, Metadata, Validation
_07_path = ProjectPath(RelativePath="output.docx")
_06_save = SaveWord(Document=_02_compose, Path=_07_path, Run=False, Overwrite=False)  # -> Path, Status
_09_path = ProjectPath(RelativePath="output.docx")
_08_open = OpenResult(Path=_09_path, Run=False)
