# Grasshopper definition example.gh (Grasshopper 1.0.8)
# plug-ins: Pawper

_01_new = NewDocument()
_03_heading = Heading(Text="Testo e formattazione", Level=0)
_05_run = TextRun(Text="Normale ", Font="Aptos", Size=11, Bold=False, Italic=False, Underline=False, Color="000000", Script="baseline")
_06_run = TextRun(Text="grassetto ", Font="Aptos", Size=11, Bold=True, Italic=False, Underline=False, Color="000000", Script="baseline")
_07_run = TextRun(Text="corsivo ", Font="Aptos", Size=11, Bold=False, Italic=True, Underline=False, Color="000000", Script="baseline")
_08_run = TextRun(Text="sottolineato ", Font="Aptos", Size=11, Bold=False, Italic=False, Underline=True, Color="000000", Script="baseline")
_09_run = TextRun(Text="colore ", Font="Aptos", Size=11, Bold=False, Italic=False, Underline=False, Color="24445C", Script="baseline")
_10_run = TextRun(Text="x", Font="Aptos", Size=11, Bold=False, Italic=False, Underline=False, Color="000000", Script="baseline")
_11_run = TextRun(Text="2", Font="Aptos", Size=11, Bold=False, Italic=False, Underline=False, Color="000000", Script="superscript")
_12_run = TextRun(Text=" H", Font="Aptos", Size=11, Bold=False, Italic=False, Underline=False, Color="000000", Script="baseline")
_13_run = TextRun(Text="2", Font="Aptos", Size=11, Bold=False, Italic=False, Underline=False, Color="000000", Script="subscript")
_14_run = TextRun(Text="O", Font="Aptos", Size=11, Bold=False, Italic=False, Underline=False, Color="000000", Script="baseline")
_04_paragraph = Paragraph(Runs=[_05_run, _06_run, _07_run, _08_run, _09_run, _10_run, _11_run, _12_run, _13_run, _14_run], StyleID="Normal")
_15_paragraph = Paragraph(
    Text="""Paragrafo con rientro e spaziatura.
Seconda riga con un'interruzione esplicita.""",
    StyleID="Normal",
    Format="""{
  "Alignment": "both",
  "Before": 6,
  "After": 12,
  "Line": 1.15,
  "LeftMm": 5,
  "RightMm": 0,
  "FirstLineMm": 5,
  "KeepNext": false
}""")
_16_paragraph = Paragraph(Text="Testo piccolo e grande", StyleID="Normal")
_18_run = TextRun(Text="Aptos 10 ", Font="Aptos", Size=10, Bold=False, Italic=False, Underline=False, Color="000000", Script="baseline")
_19_run = TextRun(Text="Arial 16", Font="Arial", Size=16, Bold=False, Italic=False, Underline=False, Color="000000", Script="baseline")
_17_paragraph = Paragraph(Runs=[_18_run, _19_run], StyleID="Normal")
_20_textblocks = TextBlocks(Text=["# Testo da un unico input", "Un paragrafo con **grassetto**, *corsivo* e ***entrambi***.", "Questa riga resta nello stesso paragrafo.", "", "Simboli letterali: \* e \$."])
_02_compose = ComposeDocument(
    Document=_01_new,
    Blocks=flatten([_03_heading, _04_paragraph, _15_paragraph, _16_paragraph, _17_paragraph, _20_textblocks]))
_21_inspect = DocumentInspector(Document=_02_compose)  # -> Structure, Styles, Bookmarks, Controls, Metadata, Validation
_23_path = ProjectPath(RelativePath="output.docx")
_22_save = SaveWord(Document=_02_compose, Path=_23_path, Run=False, Overwrite=False)  # -> Path, Status
_25_path = ProjectPath(RelativePath="output.docx")
_24_open = OpenResult(Path=_25_path, Run=False)
