# Grasshopper definition example.gh (Grasshopper 1.0.8)
# plug-ins: Pawper

_02_heading = Heading(Text="Stili del progetto", Level=0)
_03_heading = Heading(Text="Sottotitolo della relazione", Level=-1)
_04_paragraph = Paragraph(Text="Questo paragrafo applica ProjectBody.", StyleID="ProjectBody")
_05_heading = Heading(Text="Intestazione livello 1", Level=1)
_06_heading = Heading(Text="Intestazione livello 2", Level=2)
_07_heading = Heading(Text="Intestazione livello 3", Level=3)
_08_heading = Heading(Text="Intestazione livello 4", Level=4)
_09_heading = Heading(Text="Intestazione livello 5", Level=5)
_10_heading = Heading(Text="Intestazione livello 6", Level=6)
_11_heading = Heading(Text="Intestazione livello 7", Level=7)
_12_heading = Heading(Text="Intestazione livello 8", Level=8)
_13_heading = Heading(Text="Intestazione livello 9", Level=9)
_15_run = TextRun(
    Text="Stile carattere Evidenza",
    Font="Aptos",
    Size=11,
    Bold=False,
    Italic=False,
    Underline=False,
    Color="000000",
    Script="baseline",
    StyleID="EmphasisProject")
_14_paragraph = Paragraph(Runs=_15_run, StyleID="Normal")
_17_cell = TableCell(Text="Elemento", ColumnSpan=1, RowSpan=1, Alignment="left")
_18_cell = TableCell(Text="Valore", ColumnSpan=1, RowSpan=1, Alignment="left")
_19_cell = TableCell(Text="Unità", ColumnSpan=1, RowSpan=1, Alignment="left")
_20_cell = TableCell(Text="Luce", ColumnSpan=1, RowSpan=1, Alignment="left")
_21_cell = TableCell(Text="6,50", ColumnSpan=1, RowSpan=1, Alignment="right")
_22_cell = TableCell(Text="m", ColumnSpan=1, RowSpan=1, Alignment="left")
_23_cell = TableCell(Text="Carico", ColumnSpan=1, RowSpan=1, Alignment="left")
_24_cell = TableCell(Text="12,35", ColumnSpan=1, RowSpan=1, Alignment="right")
_25_cell = TableCell(Text="kN/m", ColumnSpan=1, RowSpan=1, Alignment="left")
_26_cell = TableCell(Text="Dato mancante", ColumnSpan=1, RowSpan=1, Alignment="left")
_27_cell = TableCell(ColumnSpan=1, RowSpan=1, Alignment="left")
_28_cell = TableCell(ColumnSpan=1, RowSpan=1, Alignment="left")
_16_rows = TableRows(
    Cells=[_17_cell, _18_cell, _19_cell, _20_cell, _21_cell, _22_cell, _23_cell, _24_cell, _25_cell, _26_cell, _27_cell, _28_cell],
    Counts=[3, 3, 3, 3])
_29_table = WordTable(
    Rows=_16_rows,
    WidthsMm=[70, 45, 40],
    Header=True,
    Options="""{
  "HeaderFill": "24445C",
  "StripeFill": "EEF3F6",
  "BorderColor": "CBD5DD",
  "PaddingMm": 2,
  "StyleId": "ProjectTable"
}""")
_30_tableformat = TableFormat(
    Table=_29_table,
    Header=RGB(36, 68, 92),
    Stripe=RGB(238, 243, 246),
    Border=RGB(203, 213, 221),
    PaddingMm=2,
    StyleID="ProjectTable")
_32_paraformat = ParagraphFormat(Alignment="left", BeforePt=0, AfterPt=8, Line=1.15, KeepNext=False)
_31_style = WordStyle(
    ID="ProjectBody",
    Name="Testo progetto",
    BasedOn="Normal",
    RunFormat="""{
  "Font": "Aptos",
  "Size": 11,
  "Bold": false,
  "Italic": false,
  "Underline": false,
  "Color": "24445C",
  "Script": null
}""",
    ParagraphFormat=_32_paraformat,
    Type="paragraph")
_34_paraformat = ParagraphFormat(Alignment="left", BeforePt=0, AfterPt=6, Line=1.15, KeepNext=False)
_33_style = WordStyle(
    ID="EmphasisProject",
    Name="Evidenza",
    BasedOn="Normal",
    RunFormat="""{
  "Font": null,
  "Size": null,
  "Bold": false,
  "Italic": true,
  "Underline": false,
  "Color": null,
  "Script": null
}""",
    ParagraphFormat=_34_paraformat,
    Type="character")
_36_paraformat = ParagraphFormat(Alignment="left", BeforePt=0, AfterPt=6, Line=1.15, KeepNext=False)
_35_style = WordStyle(
    ID="ProjectTable",
    Name="Tabella progetto",
    BasedOn="Normal",
    RunFormat="""{
  "Font": "Aptos",
  "Size": 11,
  "Bold": false,
  "Italic": false,
  "Underline": false,
  "Color": null,
  "Script": null
}""",
    ParagraphFormat=_36_paraformat,
    Type="table")
_01_quickdoc = QuickDocument(
    Blocks=flatten([_02_heading, _03_heading, _04_paragraph, _05_heading, _06_heading, _07_heading, _08_heading, _09_heading, _10_heading, _11_heading, _12_heading, _13_heading, _14_paragraph, _30_tableformat]),
    Styles=[_31_style, _33_style, _35_style])
_37_inspect = DocumentInspector(Document=_01_quickdoc)  # -> Structure, Styles, Bookmarks, Controls, Metadata, Validation
_39_path = ProjectPath(RelativePath="output.docx")
_38_save = SaveWord(Document=_01_quickdoc, Path=_39_path, Run=False, Overwrite=False)  # -> Path, Status
_41_path = ProjectPath(RelativePath="output.docx")
_40_open = OpenResult(Path=_41_path, Run=False)
