# Grasshopper definition example.gh (Grasshopper 1.0.8)
# plug-ins: Pawper

_01_new = NewDocument()
_03_heading = Heading(Text="Elenchi", Level=0)
_04_list = ListItem(Text="Prima voce", Level=0, Bullet=False, Group="default")
_05_list = ListItem(Text="Sottovoce", Level=1, Bullet=False, Group="default")
_06_list = ListItem(Text="Dettaglio", Level=2, Bullet=False, Group="default")
_07_list = ListItem(Text="Seconda voce", Level=0, Bullet=False, Group="default")
_08_list = ListItem(Text="Punto principale", Level=0, Bullet=True, Group="default")
_09_list = ListItem(Text="Punto secondario", Level=1, Bullet=True, Group="default")
_10_list = ListItem(Text="Nuovo elenco", Level=0, Bullet=False, Group="second")
_11_textblocks = TextBlocks(Text=["# Elenchi da testo", "- Primo punto", "  - Sottopunto", "+ Secondo punto", "", "1. Prima fase", "2. Seconda fase", "", "1. Nuovo elenco numerato"])
_02_compose = ComposeDocument(
    Document=_01_new,
    Blocks=flatten([_03_heading, _04_list, _05_list, _06_list, _07_list, _08_list, _09_list, _10_list, _11_textblocks]))
_12_inspect = DocumentInspector(Document=_02_compose)  # -> Structure, Styles, Bookmarks, Controls, Metadata, Validation
_14_path = ProjectPath(RelativePath="output.docx")
_13_save = SaveWord(Document=_02_compose, Path=_14_path, Run=False, Overwrite=False)  # -> Path, Status
_16_path = ProjectPath(RelativePath="output.docx")
_15_open = OpenResult(Path=_16_path, Run=False)
