# Grasshopper definition example.gh (Grasshopper 1.0.8)
# plug-ins: Pawper

_01_new = NewDocument()
_03_heading = Heading(Text="Tabelle intere da dati e testo", Level=0)
_04_paragraph = Paragraph(
    Text="Quattro modi per trasformare dati tabellari in tabelle Word modificabili. I valori mancanti restano vuoti e i codici mantengono gli zeri iniziali.",
    StyleID="Normal")
_05_heading = Heading(Text="Dati organizzati per righe", Level=1)
_06_quicktable = QuickTable(
    Data=Tree({2;10}: ["Luce", 6.5, "m"], {2;13}: ["Carico", 12.3456, "kN/m"], {2;16}: ["Dato mancante"]),
    Headers=["Elemento", "Valore", "Unità"],
    Columns=False,
    Decimals=2,
    Culture="it-IT",
    WidthsMm=[70, 45, 40],
    Strict=False)  # -> Block, Rows
_07_heading = Heading(Text="Dati organizzati per colonne", Level=1)
_08_quicktable = QuickTable(
    Data=Tree({2;10}: ["Trave A", "Trave B", "Mancante"], {2;13}: [1234.567, 28.9], {2;16}: [4.1234, 3.8]),
    Headers=["Elemento", "Forza", "Lunghezza"],
    Columns=True,
    Decimals=[-1, 2, 3],
    Units=["", "kN", "m"],
    Culture="en-US",
    WidthsMm=[70, 45, 40],
    Strict=False)  # -> Block, Rows
_09_break = PageBreak()
_10_heading = Heading(Text="Testo copiato da Excel", Level=1)
_11_texttable = TextTable(
    Text=["Codice\tDescrizione\tValore", "001\t\"Prima riga", "seconda riga\"\t12,50", "002\t\"Testo con \"\"virgolette\"\"\"\t", "003\tDato mancante"],
    Separator="auto",
    Header=True,
    WidthsMm=[25, 90, 40])  # -> Block, Rows, Separator
_12_heading = Heading(Text="CSV senza intestazione", Level=1)
_13_texttable = TextTable(
    Text=["A;\"Testo; con separatore\";12,50", "B;\"Virgolette \"\"OK\"\"\";", "C;Fine;0"],
    Separator=";",
    Header=False,
    WidthsMm=[25, 90, 40])  # -> Block, Rows, Separator
_14_paragraph = Paragraph(Text="Italiano: 1.234,57 kN", StyleID="Normal")
_15_paragraph = Paragraph(Text="English: 1,234.567 kN", StyleID="Normal")
_02_compose = ComposeDocument(
    Document=_01_new,
    Blocks=flatten([_03_heading, _04_paragraph, _05_heading, _06_quicktable.Block, _07_heading, _08_quicktable.Block, _09_break, _10_heading, _11_texttable.Block, _12_heading, _13_texttable.Block, _14_paragraph, _15_paragraph]))
_16_quicktable = QuickTable(Data=Tree({2;10}: [1, 2], {2;13}: [3, 4]), Columns=False, Decimals=1, Units="mm", Culture="it-IT", Strict=True)  # -> Block, Rows
_17_number = FormatNumber(Value=1234.567, Decimals=2, Unit="kN", Culture="it-IT")
_18_paragraph = Paragraph(Text=_17_number, StyleID="Normal")
_19_number = FormatNumber(Value=1234.567, Decimals=3, Unit="kN", Culture="en-US")
_20_paragraph = Paragraph(Text=_19_number, StyleID="Normal")
_21_inspect = DocumentInspector(Document=_02_compose)  # -> Structure, Styles, Bookmarks, Controls, Metadata, Validation
_23_path = ProjectPath(RelativePath="output.docx")
_22_save = SaveWord(Document=_02_compose, Path=_23_path, Run=False, Overwrite=False)  # -> Path, Status
_25_path = ProjectPath(RelativePath="output.docx")
_24_open = OpenResult(Path=_25_path, Run=False)
