# Grasshopper definition example.gh (Grasshopper 1.0.8)
# plug-ins: Pawper

_01_new = NewDocument()
_03_heading = Heading(Text="Tabella composta", Level=0)
_05_cell = TableCell(Text="Verifiche", ColumnSpan=2, RowSpan=1, Alignment="left")
_06_cell = TableCell(Text="Esito", ColumnSpan=1, RowSpan=1, Alignment="left")
_07_cell = TableCell(Text="Gruppo A", ColumnSpan=1, RowSpan=2, Alignment="left")
_08_cell = TableCell(Text="Resistenza", ColumnSpan=1, RowSpan=1, Alignment="left")
_09_cell = TableCell(Text="OK", ColumnSpan=1, RowSpan=1, Fill="DDEEDD", Alignment="center")
_10_cell = TableCell(Text="Deformazione", ColumnSpan=1, RowSpan=1, Alignment="left")
_13_run = TextRun(Text="ATTENZIONE", Font="Aptos", Size=11, Bold=True, Italic=False, Underline=False, Color="000000", Script="baseline")
_12_paragraph = Paragraph(Runs=_13_run, StyleID="Normal")
_11_cell = TableCell(Blocks=_12_paragraph, ColumnSpan=1, RowSpan=1, Fill="FFF0CC", Alignment="left")
_14_cell = TableCell(Text="Schema", ColumnSpan=2, RowSpan=1, Alignment="left")
_16_image = WordImage(
    PathOrBase64=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,
    WidthMm=35,
    AltText="Schema di una trave appoggiata con carico distribuito",
    Format="png",
    Alignment="center")
_15_cell = TableCell(Blocks=_16_image, ColumnSpan=1, RowSpan=1, Alignment="left")
_04_rows = TableRows(Cells=[_05_cell, _06_cell, _07_cell, _08_cell, _09_cell, _10_cell, _11_cell, _14_cell, _15_cell], Counts=[2, 3, 2, 2])
_17_table = WordTable(
    Rows=_04_rows,
    WidthsMm=[40, 65, 50],
    Header=True,
    Options="""{
  "HeaderFill": "DCEAF2",
  "StripeFill": "F3F6F8",
  "BorderColor": "D9D9D9",
  "PaddingMm": 2.5,
  "StyleId": null
}""")
_18_tableformat = TableFormat(Table=_17_table, Header=RGB(220, 234, 242), Stripe=RGB(243, 246, 248), Border=RGB(217, 217, 217), PaddingMm=2.5)
_02_compose = ComposeDocument(Document=_01_new, Blocks=flatten([_03_heading, _18_tableformat]))
_19_inspect = DocumentInspector(Document=_02_compose)  # -> Structure, Styles, Bookmarks, Controls, Metadata, Validation
_21_path = ProjectPath(RelativePath="output.docx")
_20_save = SaveWord(Document=_02_compose, Path=_21_path, Run=False, Overwrite=False)  # -> Path, Status
_23_path = ProjectPath(RelativePath="output.docx")
_22_open = OpenResult(Path=_23_path, Run=False)
