# Grasshopper definition example.gh (Grasshopper 1.0.8)
# plug-ins: Pawper

_01_new = NewDocument()
_03_heading = Heading(Text="Immagini del progetto", Level=0)
_04_image = WordImage(
    PathOrBase64=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,
    WidthMm=120,
    AltText="Schema di una trave appoggiata con carico distribuito",
    Caption="Schema geometrico dimostrativo",
    Format="png",
    Alignment="center")
_05_image = WordImage(
    PathOrBase64=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,
    WidthMm=80,
    AltText="Schema di una trave appoggiata con carico distribuito",
    Caption="Versione JPEG",
    Format="jpg",
    Alignment="left")
_02_compose = ComposeDocument(Document=_01_new, Blocks=flatten([_03_heading, _04_image, _05_image]))
_06_capture = CaptureRhinoView(WidthPixels=1600, HeightPixels=1000, Transparent=False, WidthMm=150, Capture=False)  # disabled
_08_path = ProjectPath(RelativePath="../assets/diagram.png")
_07_image = WordImage(PathOrBase64=_08_path, WidthMm=100, AltText="Schema da file", Alignment="center")
_09_inspect = DocumentInspector(Document=_02_compose)  # -> Structure, Styles, Bookmarks, Controls, Metadata, Validation
_11_path = ProjectPath(RelativePath="output.docx")
_10_save = SaveWord(Document=_02_compose, Path=_11_path, Run=False, Overwrite=False)  # -> Path, Status
_13_path = ProjectPath(RelativePath="output.docx")
_12_open = OpenResult(Path=_13_path, Run=False)
