# Grasshopper definition example.gh (Grasshopper 1.0.8)
# plug-ins: Pawper

_01_new = NewDocument()
_03_heading = Heading(Text="Equazioni native", Level=0)
_05_run = TextRun(
    Text="La relazione ",
    Font="Aptos",
    Size=11,
    Bold=False,
    Italic=False,
    Underline=False,
    Color="000000",
    Script="baseline")
_06_run = TextRun(
    Font="Aptos",
    Size=11,
    Bold=False,
    Italic=False,
    Underline=False,
    Color="000000",
    Script="baseline",
    Math="\sigma=\frac{N}{A}")
_07_run = TextRun(
    Text=" è una formula inline modificabile.",
    Font="Aptos",
    Size=11,
    Bold=False,
    Italic=False,
    Underline=False,
    Color="000000",
    Script="baseline")
_04_paragraph = Paragraph(Runs=[_05_run, _06_run, _07_run], StyleID="Normal")
_08_equation = WordEquation(LaTeX="x_1^2+\sqrt[3]{a}=\frac{b}{c}", Inline=False, Numbered=False)
_09_equation = WordEquation(LaTeX="\alpha+\beta+\gamma=\pi", Inline=True, Numbered=False)
_10_textblocks = TextBlocks(Text=["# Formule da testo", "La tensione vale $\sigma=\frac{N}{A}$ nel modello dimostrativo.", "", "$$x_1^2+\sqrt{a}$$", "", "$$", "\sum_{i=1}^{n}{x_i}", "$$"])
_02_compose = ComposeDocument(Document=_01_new, Blocks=flatten([_03_heading, _04_paragraph, _08_equation, _09_equation, _10_textblocks]))
_11_inspect = DocumentInspector(Document=_02_compose)  # -> Structure, Styles, Bookmarks, Controls, Metadata, Validation
_13_path = ProjectPath(RelativePath="output.docx")
_12_save = SaveWord(Document=_02_compose, Path=_13_path, Run=False, Overwrite=False)  # -> Path, Status
_15_path = ProjectPath(RelativePath="output.docx")
_14_open = OpenResult(Path=_15_path, Run=False)
