# Grasshopper definition example.gh (Grasshopper 1.0.8)
# plug-ins: Pawper

_01_new = NewDocument()
_03_heading = Heading(Text="Formule strutturate", Level=0)
_04_equation = WordEquation(LaTeX="\sum_{i=1}^{n}{x_i}", Inline=False, Numbered=True, Bookmark="EqSum")
_05_equation = WordEquation(LaTeX="\int_0^L{q(x)}\,dx", Inline=False, Numbered=False)
_06_equation = WordEquation(LaTeX="\prod_{i=1}^{n}{a_i}", Inline=False, Numbered=False)
_07_equation = WordEquation(LaTeX="A=\begin{pmatrix}a&b\\c&d\end{pmatrix}", Inline=False, Numbered=False)
_08_equation = WordEquation(LaTeX="B=\begin{bmatrix}1&0\\0&1\end{bmatrix}", Inline=False, Numbered=False)
_09_equation = WordEquation(LaTeX="C=\begin{matrix}1&2\\3&4\end{matrix}", Inline=False, Numbered=False)
_10_field = WordField(Instruction="REF EqSum \h", Placeholder="Riferimento da aggiornare", StyleID="Normal")
_02_compose = ComposeDocument(
    Document=_01_new,
    Blocks=flatten([_03_heading, _04_equation, _05_equation, _06_equation, _07_equation, _08_equation, _09_equation, _10_field]))
_11_inspect = DocumentInspector(Document=_02_compose)  # -> Structure, Styles, Bookmarks, Controls, Metadata, Validation
_13_path = ProjectPath(RelativePath="output.docx")
_12_save = SaveWord(Document=_02_compose, Path=_13_path, Run=False, Overwrite=False)  # -> Path, Status
_15_path = ProjectPath(RelativePath="output.docx")
_14_open = OpenResult(Path=_15_path, Run=False)
