# Grasshopper definition example.gh (Grasshopper 1.0.8)
# plug-ins: Pawper

_01_new = NewDocument()
_03_heading = Heading(Text="Indici del documento", Level=0)
_04_field = WordField(Instruction="TOC \\o \"1-3\" \\h \\z \\u", Placeholder="Aggiornare il campo in Word", StyleID="Normal")
_05_heading = Heading(Text="Figure", Level=1)
_06_field = WordField(Instruction="TOC \\h \\z \\c \"Figure\"", Placeholder="Aggiornare il campo in Word", StyleID="Normal")
_07_heading = Heading(Text="Tabelle", Level=1)
_08_field = WordField(Instruction="TOC \\h \\z \\c \"Table\"", Placeholder="Aggiornare il campo in Word", StyleID="Normal")
_09_break = PageBreak()
_10_heading = Heading(Text="Risultati", Level=1)
_11_image = WordImage(
    PathOrBase64=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,
    WidthMm=90,
    AltText="Schema di una trave appoggiata con carico distribuito",
    Caption="Schema geometrico dimostrativo",
    Format="png",
    Alignment="center")
_13_run = TextRun(Text="Tabella ", Font="Aptos", Size=11, Bold=False, Italic=False, Underline=False, Color="000000", Script="baseline")
_14_run = TextRun(
    Text="1",
    Font="Aptos",
    Size=11,
    Bold=False,
    Italic=False,
    Underline=False,
    Color="000000",
    Script="baseline",
    Field="SEQ Table \* ARABIC")
_15_run = TextRun(
    Text=" — Dati di ingresso",
    Font="Aptos",
    Size=11,
    Bold=False,
    Italic=False,
    Underline=False,
    Color="000000",
    Script="baseline")
_12_paragraph = Paragraph(Runs=[_13_run, _14_run, _15_run], StyleID="Caption")
_17_cell = TableCell(Text="Elemento", ColumnSpan=1, RowSpan=1, Alignment="left")
_18_cell = TableCell(Text="Valore", ColumnSpan=1, RowSpan=1, Alignment="left")
_19_cell = TableCell(Text="Unità", ColumnSpan=1, RowSpan=1, Alignment="left")
_20_cell = TableCell(Text="Luce", ColumnSpan=1, RowSpan=1, Alignment="left")
_21_cell = TableCell(Text="6,50", ColumnSpan=1, RowSpan=1, Alignment="right")
_22_cell = TableCell(Text="m", ColumnSpan=1, RowSpan=1, Alignment="left")
_23_cell = TableCell(Text="Carico", ColumnSpan=1, RowSpan=1, Alignment="left")
_24_cell = TableCell(Text="12,35", ColumnSpan=1, RowSpan=1, Alignment="right")
_25_cell = TableCell(Text="kN/m", ColumnSpan=1, RowSpan=1, Alignment="left")
_26_cell = TableCell(Text="Dato mancante", ColumnSpan=1, RowSpan=1, Alignment="left")
_27_cell = TableCell(ColumnSpan=1, RowSpan=1, Alignment="left")
_28_cell = TableCell(ColumnSpan=1, RowSpan=1, Alignment="left")
_16_rows = TableRows(
    Cells=[_17_cell, _18_cell, _19_cell, _20_cell, _21_cell, _22_cell, _23_cell, _24_cell, _25_cell, _26_cell, _27_cell, _28_cell],
    Counts=[3, 3, 3, 3])
_29_table = WordTable(
    Rows=_16_rows,
    WidthsMm=[70, 45, 40],
    Header=True,
    Options="""{
  "HeaderFill": "24445C",
  "StripeFill": "EEF3F6",
  "BorderColor": "CBD5DD",
  "PaddingMm": 2,
  "StyleId": null
}""")
_02_compose = ComposeDocument(
    Document=_01_new,
    Blocks=flatten([_03_heading, _04_field, _05_heading, _06_field, _07_heading, _08_field, _09_break, _10_heading, _11_image, _12_paragraph, _29_table]))
_30_inspect = DocumentInspector(Document=_02_compose)  # -> Structure, Styles, Bookmarks, Controls, Metadata, Validation
_32_path = ProjectPath(RelativePath="output.docx")
_31_save = SaveWord(Document=_02_compose, Path=_32_path, Run=False, Overwrite=False)  # -> Path, Status
_34_path = ProjectPath(RelativePath="output.docx")
_33_open = OpenResult(Path=_34_path, Run=False)
