# Grasshopper definition example.gh (Grasshopper 1.0.8)
# plug-ins: Pawper

_01_new = NewDocument()
_03_heading = Heading(Text="Navigazione", Level=0)
_05_run = TextRun(
    Text="Documentazione Rhino",
    Font="Aptos",
    Size=11,
    Bold=False,
    Italic=False,
    Underline=False,
    Color="000000",
    Script="baseline",
    Link="https://developer.rhino3d.com/")
_04_paragraph = Paragraph(Runs=_05_run, StyleID="Normal")
_07_run = TextRun(
    Text="Vai ai risultati",
    Font="Aptos",
    Size=11,
    Bold=False,
    Italic=False,
    Underline=False,
    Color="000000",
    Script="baseline",
    Link="#Risultati")
_06_paragraph = Paragraph(Runs=_07_run, StyleID="Normal")
_09_heading = Heading(Text="Risultati verificati", Level=1)
_08_bookmark = Bookmark(Name="Risultati", Blocks=_09_heading)
_10_field = WordField(Instruction="REF Risultati \h", Placeholder="Aggiornare il campo in Word", StyleID="Normal")
_11_field = WordField(Instruction="PAGEREF Risultati \h", Placeholder="Aggiornare il campo in Word", StyleID="Normal")
_02_compose = ComposeDocument(Document=_01_new, Blocks=flatten([_03_heading, _04_paragraph, _06_paragraph, _08_bookmark, _10_field, _11_field]))
_12_inspect = DocumentInspector(Document=_02_compose)  # -> Structure, Styles, Bookmarks, Controls, Metadata, Validation
_14_path = ProjectPath(RelativePath="output.docx")
_13_save = SaveWord(Document=_02_compose, Path=_14_path, Run=False, Overwrite=False)  # -> Path, Status
_16_path = ProjectPath(RelativePath="output.docx")
_15_open = OpenResult(Path=_16_path, Run=False)
