# Grasshopper definition example.gh (Grasshopper 1.0.8)
# plug-ins: Pawper

_01_new = NewDocument()
_03_heading = Heading(Text="Proprietà del progetto", Level=0)
_04_paragraph = Paragraph(Text="Le proprietà sono memorizzate nel pacchetto DOCX.", StyleID="Normal")
_02_compose = ComposeDocument(Document=_01_new, Blocks=flatten([_03_heading, _04_paragraph]))
_05_metadata = DocumentMetadata(
    Document=_02_compose,
    Title="Scheda progetto",
    Author="Studio dimostrativo",
    Subject="Documentazione parametrica",
    Keywords="Pawper; report",
    Custom="""{
  "Revisione": "A",
  "Codice": "PRJ-001"
}""")
_06_inspect = DocumentInspector(Document=_05_metadata)  # -> Structure, Styles, Bookmarks, Controls, Metadata, Validation
_08_path = ProjectPath(RelativePath="output.docx")
_07_save = SaveWord(Document=_05_metadata, Path=_08_path, Run=False, Overwrite=False)  # -> Path, Status
_10_path = ProjectPath(RelativePath="output.docx")
_09_open = OpenResult(Path=_10_path, Run=False)
