# Grasshopper definition example.gh (Grasshopper 1.0.8)
# plug-ins: Pawper

_02_path = ProjectPath(RelativePath="../assets/template.docx")
_01_new = NewDocument(TemplatePath=_02_path)
_04_paragraph = Paragraph(Text="Aggiunta con stile del template", StyleID="ProjectBody")
_03_compose = ComposeDocument(Document=_01_new, Blocks=flatten(_04_paragraph))
_05_fill = FillTemplate(
    Document=_03_compose,
    Values="""{
  "Cliente": "Cliente esempio",
  "Progetto": "Edificio dimostrativo"
}""",
    Strict=True)
_06_inspect = DocumentInspector(Document=_05_fill)  # -> Structure, Styles, Bookmarks, Controls, Metadata, Validation
_08_path = ProjectPath(RelativePath="output.docx")
_07_save = SaveWord(Document=_05_fill, Path=_08_path, Run=False, Overwrite=False)  # -> Path, Status
_10_path = ProjectPath(RelativePath="output.docx")
_09_open = OpenResult(Path=_10_path, Run=False)
