# Grasshopper definition example.gh (Grasshopper 1.0.8)
# plug-ins: Pawper

_02_path = ProjectPath(RelativePath="../assets/template.dotx")
_01_new = NewDocument(TemplatePath=_02_path)
_03_compose = ComposeDocument(Document=_01_new)
_06_heading = Heading(Text="Dati del progetto", Level=1)
_08_cell = TableCell(Text="Elemento", ColumnSpan=1, RowSpan=1, Alignment="left")
_09_cell = TableCell(Text="Valore", ColumnSpan=1, RowSpan=1, Alignment="left")
_10_cell = TableCell(Text="Unità", ColumnSpan=1, RowSpan=1, Alignment="left")
_11_cell = TableCell(Text="Luce", ColumnSpan=1, RowSpan=1, Alignment="left")
_12_cell = TableCell(Text="6,50", ColumnSpan=1, RowSpan=1, Alignment="right")
_13_cell = TableCell(Text="m", ColumnSpan=1, RowSpan=1, Alignment="left")
_14_cell = TableCell(Text="Carico", ColumnSpan=1, RowSpan=1, Alignment="left")
_15_cell = TableCell(Text="12,35", ColumnSpan=1, RowSpan=1, Alignment="right")
_16_cell = TableCell(Text="kN/m", ColumnSpan=1, RowSpan=1, Alignment="left")
_17_cell = TableCell(Text="Dato mancante", ColumnSpan=1, RowSpan=1, Alignment="left")
_18_cell = TableCell(ColumnSpan=1, RowSpan=1, Alignment="left")
_19_cell = TableCell(ColumnSpan=1, RowSpan=1, Alignment="left")
_07_rows = TableRows(
    Cells=[_08_cell, _09_cell, _10_cell, _11_cell, _12_cell, _13_cell, _14_cell, _15_cell, _16_cell, _17_cell, _18_cell, _19_cell],
    Counts=[3, 3, 3, 3])
_20_table = WordTable(
    Rows=_07_rows,
    WidthsMm=[70, 45, 40],
    Header=True,
    Options="""{
  "HeaderFill": "24445C",
  "StripeFill": "EEF3F6",
  "BorderColor": "CBD5DD",
  "PaddingMm": 2,
  "StyleId": null
}""")
_21_image = WordImage(
    PathOrBase64=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,
    WidthMm=80,
    AltText="Schema di una trave appoggiata con carico distribuito",
    Caption="Schema geometrico dimostrativo",
    Format="png",
    Alignment="center")
_05_target = TemplateTarget(Name="Contenuti", Blocks=[_06_heading, _20_table, _21_image], Bookmark=False)
_23_paragraph = Paragraph(Text="Cliente dimostrativo", StyleID="Normal")
_22_target = TemplateTarget(Name="Cliente", Blocks=_23_paragraph, Bookmark=True)
_04_fill = FillTemplate(Document=_03_compose, Values="{}", Targets=[_05_target, _22_target], Strict=True)
_25_paragraph = Paragraph(Text="Contenuto iniziale del controllo", StyleID="Normal")
_24_control = ContentControl(Tag="NuovoControllo", Blocks=_25_paragraph)
_26_inspect = DocumentInspector(Document=_04_fill)  # -> Structure, Styles, Bookmarks, Controls, Metadata, Validation
_28_path = ProjectPath(RelativePath="output.docx")
_27_save = SaveWord(Document=_04_fill, Path=_28_path, Run=False, Overwrite=False)  # -> Path, Status
_30_path = ProjectPath(RelativePath="output.docx")
_29_open = OpenResult(Path=_30_path, Run=False)
