# Grasshopper definition example.gh (Grasshopper 1.0.8)
# plug-ins: Pawper

_01_new = NewDocument()
_03_heading = Heading(Text="Schede degli elementi", Level=0)
_05_heading = Heading(Text="Elemento {{Id}}", Level=2)
_06_paragraph = Paragraph(Text="Lunghezza {{L}} m", StyleID="Normal")
_04_repeat = RepeatBlocks(Blocks=[_05_heading, _06_paragraph], Records="[{\"Id\":\"A\",\"L\":\"4.50\"},{\"Id\":\"B\",\"L\":\"6.00\"}]")
_08_paragraph = Paragraph(Text="Nota inclusa perché la condizione è vera.", StyleID="Normal")
_07_if = ConditionalBlocks(Condition=True, Blocks=_08_paragraph)
_10_paragraph = Paragraph(Text="Questa frase non deve comparire.", StyleID="Normal")
_09_if = ConditionalBlocks(Condition=False, Blocks=_10_paragraph)
_02_compose = ComposeDocument(Document=_01_new, Blocks=flatten([_03_heading, _04_repeat, _07_if, _09_if]))
_11_inspect = DocumentInspector(Document=_02_compose)  # -> Structure, Styles, Bookmarks, Controls, Metadata, Validation
_13_path = ProjectPath(RelativePath="output.docx")
_12_save = SaveWord(Document=_02_compose, Path=_13_path, Run=False, Overwrite=False)  # -> Path, Status
_15_path = ProjectPath(RelativePath="output.docx")
_14_open = OpenResult(Path=_15_path, Run=False)
