# Grasshopper definition example.gh (Grasshopper 1.0.8)
# plug-ins: Pawper

_01_new = NewDocument()
_03_heading = Heading(Text="Annotazioni", Level=0)
_04_note = WordNote(Anchor="Dato con approfondimento", Text="Nota a piè di pagina dimostrativa.", Endnote=False)
_05_note = WordNote(Anchor="Metodo di riferimento", Text="Nota finale dimostrativa.", Endnote=True)
_06_comment = WordComment(Anchor="Testo da verificare", Text="Confermare questo dato prima della consegna.", Author="Revisore")
_02_compose = ComposeDocument(Document=_01_new, Blocks=flatten([_03_heading, _04_note, _05_note, _06_comment]))
_07_inspect = DocumentInspector(Document=_02_compose)  # -> Structure, Styles, Bookmarks, Controls, Metadata, Validation
_09_path = ProjectPath(RelativePath="output.docx")
_08_save = SaveWord(Document=_02_compose, Path=_09_path, Run=False, Overwrite=False)  # -> Path, Status
_11_path = ProjectPath(RelativePath="output.docx")
_10_open = OpenResult(Path=_11_path, Run=False)
