# Grasshopper definition example.gh (Grasshopper 1.0.8)
# plug-ins: Pawper

_01_new = NewDocument()
_03_heading = Heading(Text="Composizione da più documenti", Level=0)
_05_path = ProjectPath(RelativePath="../assets/source.docx")
_04_import = ImportContent(Path=_05_path, Indices=[0, 1, 2, 3, 4, 5, 6])
_07_path = ProjectPath(RelativePath="../assets/source.docx")
_06_import = ImportContent(Path=_07_path, Indices=[1, 2, 3])
_02_compose = ComposeDocument(Document=_01_new, Blocks=flatten([_03_heading, _04_import, _06_import]))
_08_inspect = DocumentInspector(Document=_02_compose)  # -> Structure, Styles, Bookmarks, Controls, Metadata, Validation
_10_path = ProjectPath(RelativePath="output.docx")
_09_save = SaveWord(Document=_02_compose, Path=_10_path, Run=False, Overwrite=False)  # -> Path, Status
_12_path = ProjectPath(RelativePath="output.docx")
_11_open = OpenResult(Path=_12_path, Run=False)
