# Grasshopper definition example.gh (Grasshopper 1.0.8)
# plug-ins: Pawper

tre_documenti_per_ramo = WordDocument(Tree({1}: ["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"], {2}: ["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"], {3}: ["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"]))
_01_new = NewDocument()
_03_heading = Heading(Text="Report batch", Level=0)
_04_paragraph = Paragraph(Text="Questo è il documento base. La definizione produce tre documenti con nomi distinti.", StyleID="Normal")
_02_compose = ComposeDocument(Document=_01_new, Blocks=flatten([_03_heading, _04_paragraph]))
_06_path = ProjectPath(RelativePath=Tree({1}: ["batch-live-1.docx"], {2}: ["batch-live-2.docx"], {3}: ["batch-live-3.docx"]))
_05_batch = SaveWordBatch(Documents=tre_documenti_per_ramo, Paths=_06_path, Run=False, Overwrite=False)
_07_inspect = DocumentInspector(Document=_02_compose)  # -> Structure, Styles, Bookmarks, Controls, Metadata, Validation
_09_path = ProjectPath(RelativePath="output.docx")
_08_save = SaveWord(Document=_02_compose, Path=_09_path, Run=False, Overwrite=False)  # -> Path, Status
_11_path = ProjectPath(RelativePath="output.docx")
_10_open = OpenResult(Path=_11_path, Run=False)
