# Grasshopper definition example.gh (Grasshopper 1.0.8)
# plug-ins: Pawper

_01_new = NewDocument()
_03_heading = Heading(Text="Relazione tecnica dimostrativa", Level=0)
_04_heading = Heading(Text="Progetto di una trave appoggiata", Level=-1)
_05_paragraph = Paragraph(Text="Esempio completo di documentazione parametrica generata da Grasshopper.", StyleID="Normal")
_06_break = PageBreak()
_07_heading = Heading(Text="Sommario", Level=1)
_08_field = WordField(Instruction="TOC \\o \"1-3\" \\h \\z \\u", Placeholder="Aggiornare il campo in Word", StyleID="Normal")
_09_heading = Heading(Text="Dati del modello", Level=1)
_10_quicktable = QuickTable(
    Data=Tree({2;10}: ["Luce", 6.5, "m"], {2;13}: ["Carico", 12.3456, "kN/m"], {2;16}: ["Dato mancante"]),
    Headers=["Elemento", "Valore", "Unità"],
    Columns=False,
    Decimals=2,
    Culture="it-IT",
    WidthsMm=[70, 45, 40],
    Strict=False)  # -> Block, Rows
_11_heading = Heading(Text="Schema e risultati", Level=1)
_12_image = WordImage(
    PathOrBase64=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,
    WidthMm=120,
    AltText="Schema di una trave appoggiata con carico distribuito",
    Caption="Schema geometrico dimostrativo",
    Format="png",
    Alignment="center")
_13_equation = WordEquation(LaTeX="M_{max}=\frac{qL^2}{8}", Inline=False, Numbered=True, Bookmark="Momento")
_14_paragraph = Paragraph(Text="La formula e i dati hanno finalità dimostrative e non costituiscono una verifica strutturale.", StyleID="Normal")
_15_note = WordNote(Anchor="Ipotesi di modello", Text="Il modello rappresenta una trave semplicemente appoggiata.", Endnote=False)
_17_layout = PageLayout(
    WidthMm=215.9,
    HeightMm=279.4,
    MarginMm=20,
    Landscape=False,
    Advanced="""{
  "WidthMm": 210,
  "HeightMm": 297,
  "MarginMm": 20,
  "Landscape": true,
  "Header": "Appendice",
  "Footer": "Pagina {{PAGE}}",
  "FirstHeader": null,
  "FirstFooter": null,
  "EvenHeader": null,
  "EvenFooter": null,
  "PageStart": null
}""")
_18_heading = Heading(Text="Appendice tabellare", Level=1)
_19_quicktable = QuickTable(
    Data=Tree({2;10}: ["Luce", 6.5, "m"], {2;13}: ["Carico", 12.3456, "kN/m"], {2;16}: ["Dato mancante"]),
    Headers=["Elemento", "Valore", "Unità"],
    Columns=False,
    Decimals=2,
    Culture="it-IT",
    WidthsMm=[70, 45, 40],
    Strict=False)  # -> Block, Rows
_16_section = Section(Layout=_17_layout, Blocks=[_18_heading, _19_quicktable.Block])
_20_layout = PageLayout(
    WidthMm=215.9,
    HeightMm=279.4,
    MarginMm=20,
    Landscape=False,
    Advanced="""{
  "WidthMm": 210,
  "HeightMm": 297,
  "MarginMm": 20,
  "Landscape": false,
  "Header": "Pawper \u2014 Relazione tecnica",
  "Footer": "Pagina {{PAGE}} di {{NUMPAGES}}",
  "FirstHeader": null,
  "FirstFooter": null,
  "EvenHeader": null,
  "EvenFooter": null,
  "PageStart": null
}""")
_02_compose = ComposeDocument(
    Document=_01_new,
    Blocks=flatten([_03_heading, _04_heading, _05_paragraph, _06_break, _07_heading, _08_field, _09_heading, _10_quicktable.Block, _11_heading, _12_image, _13_equation, _14_paragraph, _15_note, _16_section]),
    Layout=_20_layout)
_21_metadata = DocumentMetadata(
    Document=_02_compose,
    Title="Relazione tecnica dimostrativa",
    Author="Pawper",
    Subject="Esempio completo",
    Keywords="relazione;Grasshopper",
    Custom="{}")
_22_inspect = DocumentInspector(Document=_21_metadata)  # -> Structure, Styles, Bookmarks, Controls, Metadata, Validation
_24_path = ProjectPath(RelativePath="output.docx")
_23_save = SaveWord(Document=_21_metadata, Path=_24_path, Run=False, Overwrite=False)  # -> Path, Status
_26_path = ProjectPath(RelativePath="output.docx")
_25_open = OpenResult(Path=_26_path, Run=False)
